# Dynamo graph Маркировка дверей Д-.dyn "Маркорка дверей Д-" (Dynamo 2.10.1.3976)

# group: Входные данные
categories = Categories("OST_Doors")
имя_параметра = StringInput("Марка")
префикс = StringInput("Д-")

# group: Обработка
all_elements_of_category = ElementsOfCategory(Category=categories)
getParameterValueByName = Element.GetParameterValueByName(element=all_elements_of_category, parameterName=имя_параметра)
code_block = CodeBlock(a=префикс, b=getParameterValueByName) { a+b; }
setParameterByName = Element.SetParameterByName(element=all_elements_of_category, parameterName=имя_параметра, value=code_block)

# group: Результат
watch = Watch(setParameterByName)
