# Dynamo graph Перемаркировка дверей по направлению.dyn (Dynamo 2.10.1.3976)

# group: Входные данные
levels = Levels("Уровень 1")
code_block = CodeBlock { "Двери"; }
string = StringInput("Марка")
code_block_2 = CodeBlock { 101; }

# group: Выборка элементов
all_elements_at_level = ElementsAtLevel(Level=levels)
watch = Watch(all_elements_at_level)
getCategory = Element.GetCategory(element=all_elements_at_level)
string_from_object = FromObject(object=getCategory)
eq = string_from_object == code_block
filterByBoolMask = List.FilterByBoolMask(list=all_elements_at_level, mask=eq)

# group: Получение координаты Х
location = FamilyInstance.Location(familyInstance=filterByBoolMask.in)
code_block_3 = CodeBlock(p=location) { p.X; }

# group: Конечная обработка
sortByKey = List.SortByKey(list=filterByBoolMask.in, keys=code_block_3)
count = List.Count(list=sortByKey.sortedList)
code_block_4 = CodeBlock(start=code_block_2, count=count) { start..(start+count-1); }
string_from_object_2 = FromObject(object=code_block_4)
setParameterByName = Element.SetParameterByName(element=sortByKey.sortedList, parameterName=string, value=string_from_object_2)
