# Dynamo graph Производитель дверей.dyn (Dynamo 2.10.1.3976)

# group: Входные данные
categories = Categories("OST_Doors")

all_elements_of_category = ElementsOfCategory(Category=categories)
code_block = CodeBlock { "Марка"; }
string = StringInput("ЮГ Двери")
setParameterByName = Element.SetParameterByName(element=all_elements_of_category, parameterName=code_block, value=string)

# group: Результат
watch = Watch(setParameterByName)
