# Dynamo graph Цвет дверей .dyn "Цвет дверей" (Dynamo 2.10.1.3976)

# group: Входные данные
categories = Categories("OST_Walls")

all_elements_of_category = ElementsOfCategory(Category=categories)
code_block = CodeBlock { "Комментарии"; }
string = StringInput("тестовый комментарий")
setParameterByName = Element.SetParameterByName(element=all_elements_of_category, parameterName=code_block, value=string)

# group: Результат
watch = Watch(setParameterByName)
